# Dynamo graph CombineTextNotes.dyn (Dynamo 2.6.1.8786)

# group: Select Elements
select_model_elements = DSModelElementsSelection()  # 18 picked in the model; graph input

# group: Filter Elements out that aren't Text Notes
getCategory = Element.GetCategory(element=select_model_elements)
string_from_object = FromObject(obj=getCategory)
categories = Categories("OST_TextNotes")
string_from_object_2 = FromObject(obj=categories)
code_block = CodeBlock(x=string_from_object, y=string_from_object_2) { x == y; }
filterByBoolMask = List.FilterByBoolMask(list=select_model_elements, mask=code_block)

# group: Create single string
text = TextNote.Text(textNote=filterByBoolMask.in)
trimWhitespace = String.TrimWhitespace(str=text)
python_script = Python(IN[0]=trimWhitespace)
# ---------- python_script.python (14 lines) ----------
# Load the Python Standard and DesignScript Libraries
import sys
import clr
clr.AddReference('ProtoGeometry')
from Autodesk.DesignScript.Geometry import *

strings_in = IN[0]
string_out = ''

for s in strings_in:
	string_out += s + ' '

# Assign your output to the OUT variable.
OUT = string_out
# ----------------------------------------

# group: Create Text Note
current = Document.Current()
activeView = Document.ActiveView(document=current)
firstItem = List.FirstItem(list=filterByBoolMask.in)
python_script_2 = Python(IN[0]=firstItem)
# ---------- python_script_2.python (13 lines) ----------
import clr

clr.AddReference('RevitAPI')
from Autodesk.Revit.DB import *

clr.AddReference('RevitNodes')
import Revit
clr.ImportExtensions(Revit.GeometryConversion)
clr.ImportExtensions(Revit.Elements)

textnote_elem = UnwrapElement(IN[0])

OUT = textnote_elem.Coord.ToPoint()
# ----------------------------------------
X = Point.X(point=python_script_2)
Y = Point.Y(point=python_script_2)
byCoordinates = Point.ByCoordinates(x=X, y=Y)
horizontalAlignment = TextNote.HorizontalAlignment(textNote=firstItem)
byLocation = TextNote.ByLocation(view=activeView, location=byCoordinates, text=python_script, alignment=horizontalAlignment)
